# Grasshopper definition GeometryOutlineAss3.gh (Grasshopper 1.0.7)
# Copyright: Co-de-iT

number_slider = Slider(1, range=0..1)
number_slider_2 = Slider(20, range=0..10000)
brep = Brep([<brep referenced from the Rhino model> x3])
contour = Contour(Shape=brep, Point=Point(0, 0, 0), Direction=Vector(0, 0, 1), Distance=number_slider_2)
lng = ListLength(List=flatten(contour))
dom = ConstructDomain(DomainStart=0, DomainEnd=lng)
bnd = Bounds(Numbers=lng)
area = Area(Geometry=contour)  # -> Area, Centroid
Z = UnitZ(Factor=number_slider_2)
range = Range(Domain=dom, Steps=lng)
dedomain = DeconstructDomain(Domain=bnd)  # -> Start, End
pdecon = Deconstruct(Point=area.Centroid)  # -> XComponent, YComponent, ZComponent
gradient = Gradient(
    LowerLimit=0,
    UpperLimit=dedomain.End,
    Parameter=range,
    stops=[0: RGB(234, 38, 0), 0: RGB(141, 53, 169), 0: RGB(41, 143, 105), 0: RGB(10, 172, 107), 0: RGB(200, 27, 7), 0.25: RGB(234, 126, 0), 0.5: RGB(254, 244, 84), 0.75: RGB(173, 203, 249), 1: RGB(75, 107, 169)])
extr = Extrude(Base=contour, Direction=Z)
cap = CapHoles(Brep=extr)
argb = SplitARGB(Colour=gradient, IntegerChannels=True)  # -> Alpha, Red, Green, Blue
preview = CustomPreview(Geometry=flatten(cap), Material=gradient)
python = GhPythonScript(r=argb.Red, g=argb.Green, b=argb.Blue)  # -> out, a; inputs r: Int32, g: Int32, b: Int32
# ---------- python: Python ----------
__author__ = "Billy"
__version__ = "2018.10.17"

import rhinoscriptsyntax as rs


def clamp(x): 
  return max(0, min(x, 255))

a= "#{0:02x}{1:02x}{2:02x}".format(clamp(r), clamp(g), clamp(b))
# ---------- end python ----------
panel = Panel("""height
base_height
colour""")
entwine = Entwine(Branch00=number_slider_2, Branch01=flatten(pdecon.ZComponent), Branch02=python.a, FlattenInputs=True)
polyjson_1_1 = PolygonToGeoJSON11(P=contour, K=panel, V=entwine)  # -> doc_2, J_2
file_write = FileWrite(
    content=polyjson_1_1.J_2,
    file_path="C:\Users\billy\Documents\GitHub\Website",
    T="draft_temple.js",
    activate=Toggle(False))

panel_2 = Panel("""{
  "type": "FeatureCollection",
  "features": [
    {
      "type": "Feature",
      "properties": {},
      "geometry": {
        "type": "LineString",
        "coordinates": [
          [
            151.20975852012634,
            -33.854281359054575
          ],
          [
            151.21201157569885,
            -33.85060151680233
          ],
          [
            151.2125265598297,
            -33.850949014737466
          ],
          [
            151.21281623840332,
            -33.85086882303175
          ],
          [
            151.212944984436,
            -33.849781772483055
          ],
          [
            151.21431827545166,
            -33.849639207450636
          ],
          [
            151.21564865112305,
            -33.85042331218469
          ],
          [
            151.21642112731934,
            -33.85163509625361
          ],
          [
            151.21775150299072,
            -33.85184893871662
          ],
          [
            151.21830940246582,
            -33.852775583203574
          ],
          [
            151.21878147125244,
            -33.85270430321531
          ],
          [
            151.2191677093506,
            -33.851991500061224
          ],
          [
            151.21972560882568,
            -33.85156381531364
          ],
          [
            151.21959686279297,
            -33.850387671216545
          ],
          [
            151.22032642364502,
            -33.849354076672036
          ],
          [
            151.2198543548584,
            -33.84860560385033
          ],
          [
            151.22002601623535,
            -33.84785712447106
          ],
          [
            151.22294425964355,
            -33.84632450337681
          ],
          [
            151.22496128082275,
            -33.84660964426676
          ],
          [
            151.22543334960935,
            -33.84546907499717
          ],
          [
            151.22809410095215,
            -33.84557600401301
          ],
          [
            151.2288236618042,
            -33.84632450337681
          ],
          [
            151.22963905334473,
            -33.846752214354865
          ],
          [
            151.23002529144284,
            -33.84735813457515
          ],
          [
            151.23092651367188,
            -33.84778584037865
          ],
          [
            151.23225688934326,
            -33.84860560385033
          ],
          [
            151.23311519622803,
            -33.84881945389711
          ],
          [
            151.23290061950684,
            -33.84799969247744
          ],
          [
            151.23148441314697,
            -33.84696606904096
          ],
          [
            151.2309694290161,
            -33.84543343196216
          ],
          [
            151.2366771697998,
            -33.844898784652635
          ],
          [
            151.2380075454712,
            -33.84429284699081
          ],
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""")
brep_2 = Brep(<brep referenced from the Rhino model>)
original = Brep([<brep referenced from the Rhino model> x3])
jsonpoly_1_1 = GeoJSONToPolyline11(J=panel_2)  # -> doc_2, P_2, K_3, V_3
crv = Curve(jsonpoly_1_1.P_2)

brep_3 = Brep(<brep referenced from the Rhino model>)
argb_2 = SplitARGB(Colour=ColourSwatch(SwatchColor=RGB(181, 152, 34)), IntegerChannels=True)  # -> Alpha, Red, Green, Blue
python_2 = GhPythonScript(r=argb_2.Red, g=argb_2.Green, b=argb_2.Blue)  # -> out, a; inputs r: Int32, g: Int32, b: Int32
# ---------- python_2: Python ----------
__author__ = "Billy"
__version__ = "2018.10.17"

import rhinoscriptsyntax as rs

def clamp(x): 
  return max(0, min(x, 255))

a= "#{0:02x}{1:02x}{2:02x}".format(clamp(r), clamp(g), clamp(b))
# ---------- end python_2 ----------
deextrusion_1_1 = DeconstructExtrusion11(brep=brep_3)  # -> doc_2, G, bh_3, bh_4
entwine_2 = Entwine(Branch00=deextrusion_1_1.bh_3, Branch01=flatten(deextrusion_1_1.bh_4), Branch02=python_2.a, FlattenInputs=True)

number_slider_3 = Slider(1, range=0..1)
modified_pos = Brep([<brep referenced from the Rhino model> x2])
number_slider_4 = Slider(10, range=0..10000)
contour_2 = Contour(Shape=original, Point=Point(0, 0, 0), Direction=Vector(0, 0, 1), Distance=number_slider_4)
Z_2 = UnitZ(Factor=number_slider_4)
panel_3 = Panel("""height
base_height
colour""")

panel_4 = Panel("""{
  "type": "FeatureCollection",
  "features": [
    {
      "type": "Feature",
      "properties": {},
      "geometry": {
        "type": "LineString",
        "coordinates": [
          [
            151.20975852012634,
            -33.854281359054575
          ],
          [
            151.21201157569885,
            -33.85060151680233
          ],
          [
            151.2125265598297,
            -33.850949014737466
          ],
          [
            151.21281623840332,
            -33.85086882303175
          ],
          [
            151.212944984436,
            -33.849781772483055
          ],
          [
            151.21431827545166,
            -33.849639207450636
          ],
          [
            151.21564865112305,
            -33.85042331218469
          ],
          [
            151.21642112731934,
            -33.85163509625361
          ],
          [
            151.21775150299072,
            -33.85184893871662
          ],
          [
            151.21830940246582,
            -33.852775583203574
          ],
          [
            151.21878147125244,
            -33.85270430321531
          ],
          [
            151.2191677093506,
            -33.851991500061224
          ],
          [
            151.21972560882568,
            -33.85156381531364
          ],
          [
            151.21959686279297,
            -33.850387671216545
          ],
          [
            151.22032642364502,
            -33.849354076672036
          ],
          [
            151.2198543548584,
            -33.84860560385033
          ],
          [
            151.22002601623535,
            -33.84785712447106
          ],
          [
            151.22294425964355,
            -33.84632450337681
          ],
          [
            151.22496128082275,
            -33.84660964426676
          ],
          [
            151.22543334960935,
            -33.84546907499717
          ],
          [
            151.22809410095215,
            -33.84557600401301
          ],
          [
            151.2288236618042,
            -33.84632450337681
          ],
          [
            151.22963905334473,
            -33.846752214354865
          ],
          [
            151.23002529144284,
            -33.84735813457515
          ],
          [
            151.23092651367188,
            -33.84778584037865
          ],
          [
            151.23225688934326,
            -33.84860560385033
          ],
          [
            151.23311519622803,
            -33.84881945389711
          ],
          [
            151.23290061950684,
            -33.84799969247744
          ],
          [
            151.23148441314697,
            -33.84696606904096
          ],
          [
            151.2309694290161,
            -33.84543343196216
          ],
          [
            151.2366771697998,
            -33.844898784652635
          ],
          [
            151.2380075454712,
            -33.84429284699081
          ],
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""")
brep_4 = Brep(<brep referenced from the Rhino model>)
jsonpoly_1_1_2 = GeoJSONToPolyline11(J=panel_4)  # -> doc_2, P_2, K_3, V_3
flatten = FlattenTree(Tree=contour_2, Path="{0}")
crv_2 = Curve(jsonpoly_1_1_2.P_2)
index = ItemIndex(List=flatten, Item=flatten)
divide = DivideCurve(Curve=reparameterize(flatten), Count=Slider(2, range=0..10), Kinks=True)  # -> Points, Tangents, simplify(Parameters)
random = Random(Range=Domain(0, 1), Number=Slider(55, range=0..100), Seed=index)  # -> simplify(Random)
merge = Merge(Data1=divide.Parameters, Data2=random)
sort = SortList(Keys=merge)  # -> Keys, ValuesA
shatter = Shatter(Curve=reparameterize(graft(flatten)), Parameters=simplify(sort.Keys))  # -> simplify(Segments)
viewer = ParamViewer(flatten)
end = EndPoints(Curve=shatter)  # -> Start, End
dispatch = Dispatch(List=shatter, DispatchPattern=[True, False])  # -> ListA, ListB
crv_3 = Curve(dispatch.ListA)
Z_3 = UnitZ(Factor=1)
eval = EvaluateCurve(Curve=reparameterize(dispatch.ListA), Parameter=0.5)  # -> Point, Tangent, Angle
xprod = CrossProduct(VectorA=Z_3, VectorB=eval.Tangent, Unitize=False)  # -> Vector, Length
amp = Amplitude(Vector=xprod.Vector, Amplitude=Slider(13, range=0..1000))
move = Move(Geometry=crv_3, Motion=amp)  # -> simplify(Geometry), Transform
crv_4 = Curve(simplify(dispatch.ListB))
weave = Weave(Pattern=[0, 1], Stream0=move.Geometry, Stream1=crv_4, NullGaps=False)
relitem = RelativeItem(Tree=weave, Offset="{0}[1]", WrapPaths=False, WrapItems=False)  # -> ItemA, ItemB
item = ListItem(List=relitem.ItemA, Index=0, Wrap=True)
item_2 = ListItem(List=relitem.ItemB, Index=0, Wrap=True)
end_2 = EndPoints(Curve=simplify(graft(relitem.ItemA)))  # -> graft(Start), graft(End)
end_3 = EndPoints(Curve=simplify(graft(relitem.ItemB)))  # -> graft(Start), graft(End)
ln = Line(StartPoint=end_2.Start, EndPoint=end_3.End)
merge_2 = Merge(Data1=end_2.Start, Data2=end_2.End, Data3=end_3.Start, Data4=end_3.End)  # -> simplify(Result)
pshift = ShiftPaths(Data=merge_2, Offset=-1)
cullpt = CullDuplicates(Points=pshift, Tolerance=0.1, CullMode=3)  # -> Points, Indices, Valence
intcrv = Interpolate(Vertices=cullpt.Points, Degree=1, Periodic=True, KnotStyle=1)  # -> simplify(Curve), Length, Domain
ln_2 = Line(StartPoint=end_2.End, EndPoint=end_3.Start)

lng_2 = ListLength(List=flatten(intcrv.Curve))
dom_2 = ConstructDomain(DomainStart=0, DomainEnd=lng_2)
bnd_2 = Bounds(Numbers=lng_2)
area_2 = Area(Geometry=intcrv.Curve)  # -> Area, Centroid
range_2 = Range(Domain=dom_2, Steps=lng_2)
dedomain_2 = DeconstructDomain(Domain=bnd_2)  # -> Start, End
pdecon_2 = Deconstruct(Point=area_2.Centroid)  # -> XComponent, YComponent, ZComponent
gradient_2 = Gradient(
    LowerLimit=0,
    UpperLimit=dedomain_2.End,
    Parameter=range_2,
    stops=[0: RGB(234, 38, 0), 0: RGB(141, 53, 169), 0: RGB(41, 143, 105), 0: RGB(10, 172, 107), 0: RGB(200, 27, 7), 0.25: RGB(234, 126, 0), 0.5: RGB(254, 244, 84), 0.75: RGB(173, 203, 249), 1: RGB(75, 107, 169)])
extr_2 = Extrude(Base=intcrv.Curve, Direction=Z_2)
argb_3 = SplitARGB(Colour=gradient_2, IntegerChannels=True)  # -> Alpha, Red, Green, Blue
python_3 = GhPythonScript(r=argb_3.Red, g=argb_3.Green, b=argb_3.Blue)  # -> out, a; inputs r: Int32, g: Int32, b: Int32; same code as python
entwine_3 = Entwine(Branch00=number_slider_4, Branch01=flatten(pdecon_2.ZComponent), Branch02=python_3.a, FlattenInputs=True)
polyjson_1_1_2 = PolygonToGeoJSON11(P=intcrv.Curve, K=panel_3, V=entwine_3)  # -> doc_2, J_2
file_write_2 = FileWrite(
    content=polyjson_1_1_2.J_2,
    file_path="C:\Users\billy\Documents\GitHub\Website",
    T="draft_temple.js",
    activate=Toggle(True))

cap_2 = CapHoles(Brep=extr_2)
panel_5 = Panel(cap_2)
preview_2 = CustomPreview(Geometry=flatten(cap_2), Material=gradient_2)

# ==== cluster GeoJSONToPolyline11: Converts GeoJSON into Grasshopper geometry.
J = ClusterInput()
J_2 = Text(J)
rep = ReplaceText(Text=J_2, Find=" ", RecursiveReplace=False)
python = PythonScript(json_string=rep)  # -> doc, polylines, key, value, xyzList, coordList
# ---------- python: Python ----------
doc = """Split featureJSON into features
more exlantion here
HELLO!!!
"""
import json
import rhinoscriptsyntax as rs
import Rhino.Geometry as rg
appendPolyline = []

def main():
    raw_json = json.loads(json_string)
    features_list = raw_json["features"]
    propertieslist = [] 
    valuelist = []
    coordList =[]
    
    for item in features_list:
        coordinates = item['geometry']['coordinates']
        coordList.append(str(coordinates))
        try:#properties
            item['properties']
            properties=item['properties']
            propertieslist.append(properties)
            value = []
            for prop in properties:
                item_value = item['properties'][prop]
                value.append(item_value)
            valuelist.append(value)
        except KeyError: 
            properties = "<null>"
            propertieslist.append(properties)
    return {
            "coordList":coordList,
            "key":propertieslist,
            "value":valuelist,
            }
results = main()
coordList = results["coordList"]
key = results["key"]
value = results["value"]
#colour= results["colour"]
#polylines = results["polylines"]
#brep = results["brep"]
# ---------- end python ----------
python_2 = PythonScript(x=python.key)  # -> simplify(a)
# ---------- python_2: Python ----------
a=x
# ---------- end python_2 ----------
python_3 = PythonScript(x=python.value)  # -> simplify(a); same code as python_2
panel = Panel("""OUTPUTS:

Polyline Curve (P)- Closed Polyline.

Keys (K) - Outputs keys found in properties

Values (V) - Outputs values found in properties""")
panel_2 = Panel(""" 
INPUTS: 

GeoJSON (J) - FeatureCollection containing geoemtry type objects.
*Only accepts easting, northing (N,E) coordinates.
 """)
panel_3 = Panel("For more documentation visit: github.com/madeleinejohanson/Humpback")
lng = ListLength(List=python.coordList)

# ---- group: List of coordinates
data = Data(python.coordList)

# ----
equals = Equality(FirstNumber=lng, SecondNumber=1)  # -> Equality, Inequality
rep_2 = ReplaceText(Text=data, Find=" ", RecursiveReplace=False)
gate = StreamGate(Gate=0)  # -> Target0, Target1
split = TextSplit(Text=rep_2, Separators=",")  # -> simplify(Result)
merge = Merge(
    Data1="GEOJSON TO POLYGON",
    Data2="Converts GeoJSON into Grasshopper geometry.",
    Data3=panel_2,
    Data4=panel,
    Data5=panel_3)
doc = Text(merge)

cull_i = CullIndex(List=split, Indices=0, Wrap=True)
cull_i_2 = CullIndex(List=cull_i, Indices=-1, Wrap=True)

doc_2 = ClusterOutput(doc)
dispatch = Dispatch(List=cull_i_2, DispatchPattern=[False, True])  # -> simplify(ListA), ListB
chars = Characters(Text=dispatch.ListA)  # -> Result, Unicode
mindex = MemberIndex(Set=chars.Result, Member="[")  # -> Index, Count
equals_2 = Equality(FirstNumber=mindex.Count, SecondNumber=2)  # -> simplify(Equality), Inequality
trim = TrimTree(Tree=equals_2.Equality, Depth=1)
ma = MassAddition(Input=trim)  # -> Result, PartialResults
dispatch_2 = Dispatch(List=dispatch.ListA, DispatchPattern=trim)  # -> ListA, ListB
larger = LargerThan(FirstNumber=flatten(ma.Result), SecondNumber=0)  # -> LargerThan, OrEqualTo
viewer = ParamViewer(ma.Result)
index = ItemIndex(List=split, Item=dispatch_2.ListA)  # -> simplify(Index)
clean = CleanTree(RemoveNulls=True, RemoveInvalid=True, RemoveEmpty=True, Tree=index)
short = ShortestList(ListA=Slider(0, range=0..100), ListB=clean, TrimMode=2)  # -> ListA, ListB
dispatch_3 = Dispatch(List=viewer, DispatchPattern=larger.LargerThan)  # -> ListA, ListB
branch = TreeBranch(Tree=split, Path=dispatch_3.ListA, MaintainPaths=True)
branch_2 = TreeBranch(Tree=split, Path=dispatch_3.ListB, MaintainPaths=True)  # -> simplify(Branch)
lng_2 = ListLength(List=branch)
merge_2 = Merge(Data1=short.ListA, Data2=index, Data3=lng_2)
cull_i_3 = CullIndex(List=merge_2, Indices=-1, Wrap=True)
shift = ShiftList(List=merge_2, Shift=1, Wrap=False)
path_mapper = PathMapper(branch_2, source="{A}", target="{A;0}")
subtraction = Subtraction(A=shift, B=cull_i_3)
partition = PartitionList(List=split, Size=subtraction)  # -> simplify(Chunks)
merge_3 = Merge(Data1=path_mapper, Data2=partition)
filter = StreamFilter(Gate=equals.Equality, Stream0=merge_3, Stream1=split)
rep_3 = ReplaceText(Text=filter, Find="[", RecursiveReplace=False)
rep_4 = ReplaceText(Text=rep_3, Find="]", RecursiveReplace=False)
dispatch_4 = Dispatch(List=rep_4, DispatchPattern=[True, False])  # -> ListA, ListB
number_slider = Slider(100000, range=0..100000)
K = Text(simplify(python_2))
V = Data(simplify(python_3))
multiplication = Multiplication(A=dispatch_4.ListB, B=number_slider)
multiplication_2 = Multiplication(A=dispatch_4.ListA, B=number_slider)
pt = ConstructPoint(XCoordinate=multiplication_2, YCoordinate=multiplication, ZCoordinate=0)
lng_3 = ListLength(List=pt)
join = TextJoin(Text=K, Join="█")
join_2 = TextJoin(Text=V, Join="█")
larger_2 = LargerThan(FirstNumber=lng_3, SecondNumber=2)  # -> LargerThan, OrEqualTo
pline = PolyLine(Vertices=pt, Closed=larger_2.LargerThan)
crv = Curve(pline)
P = Curve(simplify(crv))
utrim = UberTrim(data=P, bool=False)
lng_4 = ListLength(List=utrim)
repeat = RepeatData(Data=join, Length=lng_4)
repeat_2 = RepeatData(Data=join_2, Length=lng_4)
split_2 = TextSplit(Text=repeat, Separators="█")  # -> simplify(Result)
split_3 = TextSplit(Text=repeat_2, Separators="█")  # -> simplify(Result)
P_2 = ClusterOutput(P)
K_2 = Text(simplify(split_2))
V_2 = Data(simplify(split_3))
K_3 = ClusterOutput(K_2)
V_3 = ClusterOutput(V_2)

# ==== cluster DeconstructExtrusion11: Deconstructs simple extrusions into polylines, heights, and base heights for later use in ‘Polygon to GeoJSON component’.
brep = ClusterInput()
brep_2 = Brep(simplify(graft(brep)))
cap = CapHoles(Brep=brep_2)
mesh = MeshBrep(
    Brep=cap,
    Settings={GridMaxCount=0, GridMinCount=16, JaggedSeams=False, MaxEdgeLength=0, MinEdgeLength=0.0001, MinTolerance=0, Refine=True, RefineAngle=0, RelativeTolerance=0.65, SimplePlanes=True, Tolerance=0})
mshadow = MeshShadow(Mesh=mesh, Light=Vector(0, 0, -1), Plane=PlaneXY(0, 0, 0))
demesh = DeconstructMesh(Mesh=mesh)  # -> Vertices, Faces, Colours, Normals
pdecon = Deconstruct(Point=demesh.Vertices)  # -> XComponent, YComponent, ZComponent
panel = Panel("Deconstructs simple extrusions into polylines, heights, and base heights for later use in ‘Polygon to GeoJSON component’.")
panel_2 = Panel(""" 
INPUTS: 

Brep (B) - Extruded or capped Breps. Must be extruded in the z axis. """)
panel_3 = Panel("""OUTPUTS:

Polyline (Crv)- Projected base polyline of Brep.

Height (H) - Height of Brep.The distance of extrusion. 

Base Height (BH) - The height of the base of the brep from the ground XY Plane.""")
sort = SortList(Keys=pdecon.ZComponent)  # -> Keys, ValuesA
item = ListItem(List=sort.Keys, Index=0, Wrap=True)  # -> Item1, Item
panel_4 = Panel("For more documentation visit: github.com/madeleinejohanson/Humpback")
subtraction = Subtraction(A=item.Item1, B=item.Item)
bh = Data(simplify(flatten(subtraction)))
bh_2 = Data(simplify(flatten(item.Item)))
Z = UnitZ(Factor=bh_2)
merge = Merge(Data1="DECONSTRUCT EXTRUSION", Data2=panel, Data3=panel_2, Data4=panel_3, Data5=panel_4)
move = Move(Geometry=flatten(mshadow), Motion=Z)  # -> Geometry, Transform
doc = Text(merge)
doc_2 = ClusterOutput(doc)
panel_5 = Panel(doc)

# ---- group: Cluster Output
bh_3 = ClusterOutput(bh)

# ----
bh_4 = ClusterOutput(bh_2)
G = ClusterOutput(move.Geometry)

# ==== cluster PolygonToGeoJSON11: Writes a polygon to a GeoJSON file, where keys and values can be defined.
P = ClusterInput()
P_2 = Curve(P)
cp = ControlPoints(Curve=P_2)  # -> simplify(Points), Weights, Knots
V = ClusterInput()
K = ClusterInput()
V_2 = Data(simplify(V))
points_to_coordinates = PointsToCoordinates(P=cp.Points)
K_2 = Text(simplify(K))
clean = CleanTree(RemoveNulls=True, RemoveInvalid=True, RemoveEmpty=True, Tree=V_2)
viewer = ParamViewer(clean)
flip = FlipMatrix(Data=clean)
graft = GraftTree(Tree=K_2, IncludeEmptyLists=True, IncludeNullItems=True)  # -> simplify(Tree)
viewer_2 = ParamViewer(graft)
short = ShortestList(ListA=viewer_2, ListB=viewer, TrimMode=2)  # -> ListA, ListB
lng = ListLength(List=flatten(short.ListB))
series = Series(Start=0, Step=1, Count=lng)
item = ListItem(List=viewer_2, Index=series, Wrap=False)
flip_2 = FlipMatrix(Data=flip)
branch = TreeBranch(Tree=graft, Path=item, MaintainPaths=True)
clean_2 = CleanTree(RemoveNulls=True, RemoveInvalid=True, RemoveEmpty=True, Tree=branch)
flatten = FlattenTree(Tree=clean_2, Path="{0}")
rep = ReplaceText(Text="\"█\"", Find="█", Replace=flatten, RecursiveReplace=False)  # -> flatten(Result)
series_2 = Series(Start=0, Step=1, Count=lng)
mindex = MemberIndex(Set=rep, Member="\"height\"")  # -> Index, Count
rep_2 = ReplaceText(Text="{ \"type\": \"Polygon\",█}", Find="█", Replace=points_to_coordinates, RecursiveReplace=False)

# ---- group: Polygon
flatten_2 = FlattenTree(Tree=rep_2, Path="{0}")

# ----
mindex_2 = MemberIndex(Set=rep, Member="\"base_height\"")  # -> Index, Count
panel = Panel("Writes a polygon to a GeoJSON file, where keys and values can be defined. ")
panel_2 = Panel("""OUTPUTS:

GeoJSON (J) - Produces a GeoJSON Feature Collection.""")
panel_3 = Panel(""" 
INPUTS: 

Polyline Curve (P) - Polygon or list of polygons to convert to GeoJSON.

Key (K)- Properties used to describe geometry. To specify height, base height and colour, use the following keys: 

height
base_height
colour 

Value (V) - Values of properties. The list should be structured so that the first branch of data is associated with the first key. This allows unique values to be associated with multiple polygons. """)
panel_4 = Panel("For more documentation visit: github.com/madeleinejohanson/Humpback")
rep_3 = ReplaceText(Text="{\"type\":\"Feature\",\"geometry\":█", Find="█", Replace=flatten_2, RecursiveReplace=False)
merge = Merge(Data1="POLYGON TO GEOJSON", Data2=panel, Data3=panel_3, Data6=panel_2, Data7=panel_4)
doc = Text(merge)
doc_2 = ClusterOutput(doc)
panel_5 = Panel(doc)

# ---- group: Keeps lists consistent lengths, repeating the last value for the total amount of keys
null = NullItem(Item=flip)  # -> NullFlags, InvalidFlags, Description
dispatch = Dispatch(List=flip, DispatchPattern=null.NullFlags)  # -> ListA, ListB
nullrep = ReplaceNulls(Items=flip, Replacements="█")  # -> Items, Count
index = ItemIndex(List=dispatch.ListB, Item=dispatch.ListB)
item_2 = ListItem(List=flip, Index=index, Wrap=True)
mindex_3 = MemberIndex(Set=nullrep.Items, Member="█")  # -> Index, Count
flip_3 = FlipMatrix(Data=item_2)
clean_3 = CleanTree(RemoveNulls=True, RemoveInvalid=True, RemoveEmpty=False, Tree=flip_3)
item_3 = ListItem(List=clean_3, Index=0, Wrap=True)  # -> flatten(Item1), Item

# ----
merge_2 = Merge(Data1=flip_3, Data2=flip_2)
clean_4 = CleanTree(RemoveNulls=True, RemoveInvalid=True, RemoveEmpty=False, Tree=merge_2)
item_4 = ListItem(List=clean_4, Index=0, Wrap=True)  # -> flatten(Item1), Item

# ---- group: Keeps lists consistent lengths, repeating the last value for the total amount of keys (continued)
item_5 = ListItem(List=item_4.Item1, Index=mindex_3.Index, Wrap=True)
replace = ReplaceItems(List=nullrep.Items, Item=item_5, Indices=mindex_3.Index, Wrap=False)

# ----
flip_4 = FlipMatrix(Data=replace)
viewer_3 = ParamViewer(flip_4)
item_6 = ListItem(List=viewer_3, Index=series_2, Wrap=True)

# ---- group: Keeps lists consistent lengths, repeating the last value for the total amount of keys (continued)
branch_2 = TreeBranch(Tree=flip_4, Path=item_6, MaintainPaths=True)  # -> simplify(Branch)

# ----
flip_5 = FlipMatrix(Data=branch_2)

# ---- group: height
item_7 = ListItem(List=flip_5, Index=mindex.Index, Wrap=True)

# ---- group: base_height
item_8 = ListItem(List=flip_5, Index=mindex_2.Index, Wrap=True)

# ----
addition = Addition(A=item_7, B=item_8)
replace_2 = ReplaceItems(List=simplify(flip_5), Item=addition, Indices=mindex.Index, Wrap=False)  # -> simplify(List)
clean_5 = CleanTree(RemoveNulls=True, RemoveInvalid=True, RemoveEmpty=True, Tree=replace_2)
key_value = KeyValue(K=clean_2, V=clean_5)
rep_4 = ReplaceText(Text=",\"properties\":█}", Find="█", Replace=key_value, RecursiveReplace=False)

# ---- group: Feature
concat = Concatenate(FragmentA=rep_3, FragmentB=rep_4)  # -> flatten(Result)

# ----
join = TextJoin(Text=concat, Join=",")
panel_6 = Panel(key_value)
rep_5 = ReplaceText(Text="{\"type\":\"FeatureCollection\",\"features\":[█]}", Find="█", Replace=join, RecursiveReplace=False)
J = Text(rep_5)
J_2 = ClusterOutput(J)

# ==== cluster FileWrite: Exports text to file
content = ClusterInput()
file_path = ClusterInput()
activate = ClusterInput()
T = ClusterInput()
content_2 = Data(content)
file_path_2 = Text(file_path)
join = TextJoin(Text=[file_path_2, T], Join="\")
vb = VBScript(path=simplify(join), lines=simplify(content_2), activate=activate)  # -> out, A
# ---------- vb: VB ----------
    If (activate = True)
      
      system.IO.File.WriteAllText(path, lines)
      A = "File written"
    Else
      A = "Not activated"
    End If
# ---------- end vb ----------

# ==== cluster UberTrim: Better version of Trim
data = ClusterInput()
bool = ClusterInput()
data_2 = Data(data)
trim = TrimTree(Tree=data_2, Depth=1)
null = NullItem(Item=trim)  # -> NullFlags, InvalidFlags, Description
dispatch = Dispatch(List=data_2, DispatchPattern=null.NullFlags)  # -> ListA, ListB
bool_2 = Boolean(bool)
trim_2 = TrimTree(Tree=dispatch.ListB, Depth=1)
bool_3 = Boolean(invert(null.NullFlags))
flatten = FlattenTree(Tree=dispatch.ListA, Path="{0}")
merge = Merge(Data1=flatten, Data2=trim_2)
panel = Panel(null.NullFlags)
trim_3 = TrimTree(Tree=data_2, Depth=bool_3)
bool_4 = Boolean(invert(bool_2))
data_3 = Data(trim_3)
dispatch_2 = Dispatch(List=merge, DispatchPattern=bool_4)  # -> ListA, ListB
dispatch_3 = Dispatch(List=data_3, DispatchPattern=bool_2)  # -> ListA, ListB
clean = CleanTree(RemoveNulls=True, RemoveInvalid=True, RemoveEmpty=True, Tree=dispatch_3.ListB)
clean_2 = CleanTree(RemoveNulls=True, RemoveInvalid=True, RemoveEmpty=True, Tree=dispatch_2.ListB)
merge_2 = Merge(Data1=clean, Data2=clean_2)
R = ClusterOutput(merge_2)
panel_2 = Panel(merge_2)

# ==== cluster PointsToCoordinates
P = ClusterInput()
number_slider = Slider(100042, range=0..1000000)
pt2num = PointsToNumbers(Points=graft(P), Mask=4)
number_slider_2 = Slider(1000404, range=0..10000000)
division = Division(A=pt2num, B=Slider(100000, range=0..100000))
expression = Expression(x=division, Expression="format(\"{0}\",x)")
int = Integer(99960)
item = ListItem(List=expression, Index=0, Wrap=True)  # -> Item, Item1, Item2
panel = Panel(pt2num)
num = Number(item.Item2)  # disabled
merge = Merge(Data1=item.Item, Data2=item.Item1, Data3=num)
panel_2 = Panel(division)
wrapper = Wrapper(wrap="[", content=merge, join=",")  # -> simplify(wrapped)
utrim = UberTrim(data=wrapper, bool=Toggle(True))
wrapper_2 = Wrapper(wrap="[", content=utrim, join=",")
rep = ReplaceText(Text="\"coordinates\": [█]", Find="█", Replace=wrapper_2, RecursiveReplace=False)  # -> simplify(Result)
R = ClusterOutput(rep)

# ==== cluster KeyValue
K = ClusterInput()
V = ClusterInput()
K_2 = Text(simplify(K))
V_2 = Data(simplify(V))

# ---- group: HUMPBACK 1.1 Treats numbers as numbers instead of strings
int = Integer(V_2)
null = NullItem(Item=int)  # -> NullFlags, InvalidFlags, Description
panel = Panel("""█
"█"
""")
item = ListItem(List=panel, Index=null.NullFlags, Wrap=True)
rep = ReplaceText(Text=item, Find="█", Replace=V_2, RecursiveReplace=False)

# ----
panel_2 = Panel(K_2)
rep_2 = ReplaceText(Text="\"█\"", Find="█", Replace=K_2, RecursiveReplace=False)  # -> simplify(Result)
panel_3 = Panel("\"█\"")  # disabled
panel_4 = Panel("█")  # disabled
rep_3 = ReplaceText(Text=panel_3, Find=panel_4, Replace=V_2, RecursiveReplace=False)  # disabled
flip = FlipMatrix(Data=rep)  # -> simplify(Data)
lng = ListLength(List=flatten(rep_2))
viewer = ParamViewer(flip)
series = Series(Start=0, Step=1, Count=lng)
item_2 = ListItem(List=viewer, Index=series, Wrap=True)
branch = TreeBranch(Tree=simplify(flip), Path=simplify(item_2), MaintainPaths=True)
long = LongestList(ListA=rep_2, ListB=branch, PaddingMode=2)  # -> ListA, ListB
merge = Merge(Data1=graft(long.ListA), Data2=graft(long.ListB))
join = TextJoin(Text=merge, Join=":")
trim = TrimTree(Tree=join, Depth=1)
flip_2 = FlipMatrix(Data=trim)
join_2 = TextJoin(Text=flip_2, Join=",")
rep_4 = ReplaceText(Text="{█}", Find="█", Replace=join_2, RecursiveReplace=False)  # -> flatten(Result)
J = Text(rep_4)
J_2 = ClusterOutput(J)

# ==== cluster Wrapper: Wraps data with a wrapping character
join = ClusterInput()  # Join character
content = ClusterInput()  # Content to be wrapped
wrap = ClusterInput()  # Wrap character or XML tag
txt = Text(join)
null = NullItem(Item=txt)  # -> NullFlags, InvalidFlags, Description
data = Data(content)
tmatch = MatchText(Text=wrap, RegEx="<*.>", Case=True)
bool = Boolean(null.NullFlags)
dispatch = Dispatch(List=data, DispatchPattern=bool)  # -> ListA, ListB
item = ListItem(List=wrap, Index=0, Wrap=True)
split = TextSplit(Text=item, Separators=" ")
join_2 = TextJoin(Text=dispatch.ListB, Join=txt)
panel = Panel("""{
[
(
"
'""")
panel_2 = Panel("""{█}
[█]
(█)
"█"
'█'""")
item_2 = ListItem(List=split, Index=0, Wrap=True)
weave = Weave(Pattern=bool, Stream0=join_2, Stream1=dispatch.ListA, NullGaps=False)
data_2 = Data(wrap)
replace = ReplaceMembers(Set=data_2, Find=panel, Replace=panel_2)
rep = ReplaceText(Text=item_2, Find="<", Replace="</", RecursiveReplace=False)
expression = Expression(x=item, y=rep, Expression="Format(\"{0}█{1}>\", x, y)")
rep_2 = ReplaceText(Text=expression, Find=">>", Replace=">", RecursiveReplace=False)
weave_2 = Weave(Pattern=tmatch, Stream0=replace, Stream1=rep_2, NullGaps=False)
rep_3 = ReplaceText(Text=weave_2, Find="█", Replace=weave, RecursiveReplace=False)
data_3 = Data(rep_3)
wrapped = ClusterOutput(data_3)  # Wrapped Output
